# Dynamo custom node Arc.ByLine.dyf (Dynamo 2.6.1.8786)
# category: Landform.Geometry.Arc
# Create an arc from the start and end point of a line. Specify the height of the arc (from 0 to 1) and (if desired) flip the arc across the line.
# packages: Landform 2016.10.13

flip = Input(flip: bool = true)
curve = Input(curve: var[]..[])
startPoint = Curve.StartPoint(curve=curve)
midPoint = Custom[Curve.MidPoint](curve=curve)  # package Landform; Get the midpoint along the Curve
endPoint = Curve.EndPoint(curve=curve)
byCenterPointStartPointEndPoint = Arc.ByCenterPointStartPointEndPoint(centerPoint=midPoint, startPoint=endPoint, endPoint=startPoint)
midPoint_2 = Custom[Curve.MidPoint](curve=byCenterPointStartPointEndPoint)
byStartPointEndPoint = Line.ByStartPointEndPoint(startPoint=midPoint, endPoint=midPoint_2)
height = Input(height: var[]..[])
pointAtSegmentLength = Curve.PointAtSegmentLength(curve=byStartPointEndPoint, segmentLength=height)
byThreePoints = Arc.ByThreePoints(firstPoint=startPoint, secondPoint=pointAtSegmentLength, thirdPoint=endPoint)
byCenterPointStartPointEndPoint_2 = Arc.ByCenterPointStartPointEndPoint(centerPoint=midPoint, startPoint=startPoint, endPoint=endPoint)
midPoint_3 = Custom[Curve.MidPoint](curve=byCenterPointStartPointEndPoint_2)
byStartPointEndPoint_2 = Line.ByStartPointEndPoint(startPoint=midPoint, endPoint=midPoint_3)
pointAtSegmentLength_2 = Curve.PointAtSegmentLength(curve=byStartPointEndPoint_2, segmentLength=height)
byThreePoints_2 = Arc.ByThreePoints(firstPoint=startPoint, secondPoint=pointAtSegmentLength_2, thirdPoint=endPoint)
if_ = If(test=flip, true=byThreePoints, false=byThreePoints_2)
Curve = Output(if_)
