# Dynamo custom node Curve.DivideByLengthRemainders.dyf (Dynamo 2.6.1.8786)
# category: Landform.Geometry.Curve
# Divides curve into curves of given length. Will return remainder at end or split the remainder between the start and end.

curve = Input(curve: var[]..[])
code_block = CodeBlock(data=curve) { data; }
startPoint = Curve.StartPoint(curve=code_block)
length = Input(length: double)
code_block_2 = CodeBlock(data=length) { data; }
pointsAtSegmentLengthFromPoint = Curve.PointsAtSegmentLengthFromPoint(curve=code_block, point=startPoint, segmentLength=code_block_2)
splitByPoints = Curve.SplitByPoints(curve=code_block, points=pointsAtSegmentLengthFromPoint)
code_block_3 = CodeBlock(data=splitByPoints) { data; }
RemainderEnd = Output(code_block_3)
lastItem = List.LastItem(list=splitByPoints, lacing=CrossProduct)
length_2 = Curve.Length(curve=lastItem)
code_block_4 = CodeBlock(l=code_block_2) { l/2; }
gt = length_2 > code_block_4
code_block_5 = CodeBlock(r=length_2, l=code_block_2) { r+l; }
if_ = If(test=gt, true=length_2, false=code_block_5)
code_block_6 = CodeBlock(r2=if_) { r2/2; }
pointAtSegmentLength = Curve.PointAtSegmentLength(curve=code_block, segmentLength=code_block_6)
pointsAtSegmentLengthFromPoint_2 = Curve.PointsAtSegmentLengthFromPoint(curve=code_block, point=pointAtSegmentLength, segmentLength=code_block_2)
splitByPoints_2 = Curve.SplitByPoints(curve=code_block, points=pointsAtSegmentLengthFromPoint_2)
code_block_7 = CodeBlock(data=splitByPoints_2) { data; }
RemainderSplit = Output(code_block_7)
