# Dynamo custom node Curve.DivideEqually.dyf (Dynamo 2.6.1.8786)
# category: Landform.Geometry.Curve
# Divides a curve into a given number of equal length curves.

curve = Input(curve: var[]..[])
divisions = Input(divisions: int)
pointsAtEqualSegmentLength = Curve.PointsAtEqualSegmentLength(curve=curve, divisions=divisions)
splitByPoints = Curve.SplitByPoints(curve=curve, points=pointsAtEqualSegmentLength)
Curve = Output(splitByPoints)  # "Curve[]"
