# Dynamo custom node Curve.DividePoints.dyf (Dynamo 2.6.1.8786)
# category: Landform.Geometry.Curve
# Get the (start) points along an equally divided curve.
# packages: Landform 2016.10.13

curve = Input(curve: var[]..[])
divisions = Input(divisions: var[]..[])
divideEqually = Custom[Curve.DivideEqually](curve=curve, divisions=divisions)  # package Landform; Divides a curve into a given number of equal length curves.
startPoint = Curve.StartPoint(curve=divideEqually)
flatten = List.Flatten(list=startPoint)
Points = Output(flatten)
code_block = CodeBlock { 0; }
removeItemAtIndex = List.RemoveItemAtIndex(list=flatten, indices=code_block)
if_ = If(true=removeItemAtIndex, false=flatten)  # unwired: test
