# Dynamo custom node Curve.MidPoint.dyf (Dynamo 2.6.1.8786)
# category: Landform.Geometry.Curve
# Get the midpoint along the Curve

curve = Input(curve: var[]..[])
length = Curve.Length(curve=curve)
code_block = CodeBlock(x=length) { x/2; }
pointAtSegmentLength = Curve.PointAtSegmentLength(curve=curve, segmentLength=code_block)
Point = Output(pointAtSegmentLength)
