# Dynamo custom node Curve.StartMidPoint.dyf (Dynamo 2.6.1.8786)
# category: Landform.Geometry.Curve
# Get the start point and midpoint along the Curve.
# packages: Landform 2016.10.13

list_create = List.Create()  # unwired: item0
curve = Input(curve: var[]..[])
startPoint = Curve.StartPoint(curve=curve)
midPoint = Custom[Curve.MidPoint](curve=curve)  # package Landform; Get the midpoint along the Curve
combine = List.Combine(comb=list_create, list1=startPoint, list2=midPoint)
code_block = CodeBlock(lst=combine) { List.Transpose(lst<1>); }
flatten = List.Flatten(list=code_block)
Points = Output(flatten)
