# Dynamo custom node Curves.Reorder.dyf (Dynamo 1.1.0.2094)
# category: Landform.Geometry.Curve
# Reorders the list of curves by creating a polycurve and returning the curves of the polycurve.

curves = Input()
flatten = Flatten(curves)
byJoinedCurves = PolyCurve.ByJoinedCurves(flatten)
isClosed = Curve.IsClosed(byJoinedCurves)
curves_2 = PolyCurve.Curves(byJoinedCurves)
closeWithLine = PolyCurve.CloseWithLine(byJoinedCurves)
curves_3 = PolyCurve.Curves(closeWithLine)
restOfItems = List.RestOfItems(curves_3)
code_block = CodeBlock(test=isClosed, iftrue=curves_2, iffalse=restOfItems) { oldif(test,iftrue,iffalse); }
Curves = Output(code_block)
code_block_2 = CodeBlock()
# ---------- code_block_2.designscript (15 lines) ----------
def oldif(test,iftrue:var[]..[],
iffalse:var[]..[])
{
return = [Imperative]
{
if (test)
{
return = iftrue;
}
else
{
return = iffalse;
}
}
};
# ----------------------------------------
