# Dynamo custom node Element.TopBasePolysurface.dyf (Dynamo 2.6.1.8786)
# category: Landform.Revit.Elements
# Get the top and bottom polysurfaces from an element.
# packages: Landform 2016.10.13

element = Input(element: var[]..[])
geometry = Element.Geometry(element=element)
faces = Element.Faces(element=geometry)
surfaceGeometry = Face.SurfaceGeometry(face=faces)
topBasePolysurface = Custom[Surfaces.TopBasePolysurface](surfaces=surfaceGeometry)  # package Landform; Get the top and bottom polysurfaces from a set of surfaces.
PolySurfaceTop = Output(topBasePolysurface.PolySurfaceTop)
PolySurfaceBase = Output(topBasePolysurface.PolySurfaceBase)
