# Dynamo custom node Elements.RandomizeParameter.dyf (Dynamo 2.6.1.8786)
# category: Landform.Revit.Elements.Parameter
# Set an element's instance parameter to a random value between a range specified by the minimum and maximum parameter.
# packages: LunchBox for Dynamo 2018.7.6

elements = Input(elements: var[]..[])
flatten = List.Flatten(list=elements)

# group: Element.Type
python_script = Python(IN[0]=flatten)
# ---------- python_script.python (12 lines) ----------
import clr
clr.AddReference('RevitAPI')
from Autodesk.Revit.DB import *

items = UnwrapElement(IN[0])
typelist = list()
for item in items:
	try: 
		typelist.append(item.Document.GetElement(item.GetTypeId()))
	except:
		typelist.append(list())
OUT = typelist
# ----------------------------------------
python_script_2 = Python(IN[0]=elements, IN[1]=python_script)
# ---------- python_script_2.python (4 lines) ----------
check = IN[0]
items = IN[1]
if isinstance(check, (list)): OUT = items
else: OUT = items[0]
# ----------------------------------------

groupByKey = List.GroupByKey(list=elements, keys=python_script_2)
instParameter = Input(instParameter: string)
minParameter = Input(minParameter: string)
getParameterValueByName = Element.GetParameterValueByName(element=groupByKey.unique_keys, parameterName=minParameter)
maxParameter = Input(maxParameter: string)
getParameterValueByName_2 = Element.GetParameterValueByName(element=groupByKey.unique_keys, parameterName=maxParameter)
count = List.Count()  # unwired: list
map = List.Map(list=groupByKey.groups, f_x=count)
code_block = CodeBlock { 0; }
randomNumbers = Lists.Sequence.RandomNumbers(Min=getParameterValueByName, Max=getParameterValueByName_2, Number=map, Seed=code_block)
setParameterByName = Element.SetParameterByName(element=groupByKey.groups, parameterName=instParameter, value=randomNumbers)
Element = Output(setParameterByName)
