# Dynamo custom node FamilyInstance.Percentage.dyf (Dynamo 2.6.1.8786)
# category: Landform.Revit.Elements.FamilyInstance
# Place familiy instances by point from a list of multiple family types and percentages. Last percentage is automatically calculated.

byPoint = FamilyInstance.ByPoint()  # unwired: familyType, point
cycle = List.Cycle()  # unwired: list, amount
familyTypes = Input(familyTypes: var[]..[])
code_block = CodeBlock { 1; }
chop = List.Chop(list=familyTypes, lengths=code_block)
points = Input(points: var[]..[])
percent = Input(percent: var[]..[])
code_block_2 = CodeBlock(ct=points, lst=percent)
# ---------- code_block_2.designscript (8 lines) ----------
Count(ct)*List.GetItemAtIndex(lst,0);
Count(ct)*List.GetItemAtIndex(lst,1);
Count(ct)*List.GetItemAtIndex(lst,2);
Count(ct)*List.GetItemAtIndex(lst,3);
Count(ct)*List.GetItemAtIndex(lst,4);
Count(ct)*List.GetItemAtIndex(lst,5);
Count(ct)*List.GetItemAtIndex(lst,6);
Count(ct)*List.GetItemAtIndex(lst,7);
# ----------------------------------------
list_create = List.Create(item0=code_block_2.out0, item1=code_block_2.out1, item2=code_block_2.out2, item3=code_block_2.out3, item4=code_block_2.out4, item5=code_block_2.out5, item6=code_block_2.out6, item7=code_block_2.out7)
clean = List.Clean(list=list_create)
round = Math.Round(number=clean)
code_block_3 = CodeBlock(ct=points, lst=round) { Count(ct)-Math.Sum(lst); }
code_block_4 = CodeBlock { 0; }
eq = code_block_3 == code_block_4
addItemToEnd = List.AddItemToEnd(item=code_block_3, list=round)
code_block_5 = CodeBlock(test=eq, iftrue=round, iffalse=addItemToEnd) { i(test,iftrue,iffalse); }
combine = List.Combine(comb=cycle, list1=chop, list2=code_block_5)
flatten = List.Flatten(list=combine)
combine_2 = List.Combine(comb=byPoint, list1=flatten, list2=points)
FamilyInstance = Output(combine_2)
code_block_6 = CodeBlock()
# ---------- code_block_6.designscript (15 lines) ----------
def i(test,iftrue:var[]..[],
iffalse:var[]..[])
{
return = [Imperative]
{
if (test)
{
return = iftrue;
}
else
{
return = iffalse;
}
}
};
# ----------------------------------------
