# Dynamo custom node FamilyInstance.RandomRotation.dyf (Dynamo 2.6.1.8786)
# category: Landform.Revit.Elements.FamilyInstance
# Rotates the angle of the family instance a random amount (between 0 and 360).
# packages: Clockwork for Dynamo 2.x 2.3.0

familyInstance = Input(familyInstance: var[]..[])
code_block = CodeBlock { 360; }
count = List.Count(list=familyInstance)
asIntegers = Custom[RandomList.AsIntegers](max=code_block, amount=count)  # package Clockwork for Dynamo 2.x; Creates a list of random integers between 0 and a given maximum value
setRotation = FamilyInstance.SetRotation(familyInstance=familyInstance, degree=asIntegers)
FamilyInstance = Output(setRotation)
