# Dynamo custom node List.MatchLength.dyf (Dynamo 2.6.1.8786)
# category: Landform.Core.List
# Cycle a list to match the length of the first list.

list = Input(list: var[]..[])
count = List.Count(list=list)
code_block = CodeBlock { 1; }
gt = count > code_block
cycle = List.Cycle()  # unwired: list, amount
listLength = Input(listLength: var[]..[])
count_2 = List.Count()  # unwired: list
map = List.Map(list=listLength, f_x=count_2)
combine = List.Combine(comb=cycle, list1=list, list2=map)
count_3 = List.Count(list=listLength)
cycle_2 = List.Cycle(list=list, amount=count_3)
code_block_2 = CodeBlock(test=gt, iftrue=combine, iffalse=cycle_2) { oldif(test,iftrue,iffalse); }
list_2 = Output(code_block_2)  # "list"
code_block_3 = CodeBlock()
# ---------- code_block_3.designscript (15 lines) ----------
def oldif(test,iftrue:var[]..[],
iffalse:var[]..[])
{
return = [Imperative]
{
if (test)
{
return = iftrue;
}
else
{
return = iffalse;
}
}
};
# ----------------------------------------
