# Dynamo custom node List.RemoveEmpty.dyf (Dynamo 0.9.0.3067)
# category: Landform.Core.List
# Removes empty indices from a list.

list = Input()
isEmpty = List.IsEmpty()
map = List.Map(list=list, f_x=isEmpty)
filterByBoolMask = List.FilterByBoolMask(list=list, mask=map)
list_2 = Output(filterByBoolMask.out)  # "list"
