# Dynamo custom node Math.RandomIntegerMin.dyf (Dynamo 0.9.0.3067)
# category: Landform.Core.Math.Create
# Creates a list of random integers between a given minimum and maximum value

amount = Input()
min = Input()
max = Input()
code_block = CodeBlock(amount=amount, min=min, max=max) { Math.Round(Math.RemapRange(Math.RandomList(amount),min-0.499,max+0.499)); }
list = Output(code_block)
