# Dynamo custom node NurbsSurface.ByNurbsCurves.dyf (Dynamo 2.6.1.8786)
# category: Landform.Geometry.NurbsSurface
# Creates a NurbsSurface with points generated from an interval along the specified curves.

addItemToEnd = List.AddItemToEnd()  # unwired: item, list
curves = Input(curves: var[]..[])
python_script = Python(IN[0]=curves)
# ---------- python_script.python (20 lines) ----------
import clr
clr.AddReference('ProtoGeometry')
from Autodesk.DesignScript.Geometry import *
#The inputs to this node will be stored as a list in the IN variable.
dataEnteringNode = IN

def ClearList(_list):
    out = []
    for _list1 in _list:
        if _list1 is None:
            continue
        if isinstance(_list1, list):
             _list1 = ClearList(_list1)
             if not _list1:
                 continue
        out.append(_list1)
    return out

#Assign your output to the OUT variable
OUT = ClearList(IN[0])
# ----------------------------------------
endPoint = Curve.EndPoint(curve=python_script)
list_create = List.Create()  # unwired: item0, item1
map = List.Map(list=endPoint, f_x=list_create)
code_block = CodeBlock(data=python_script) { data; }
length = Curve.Length(curve=python_script)
maximumItem = List.MaximumItem(list=length)
interval = Input(interval: double)
code_block_2 = CodeBlock(data=interval) { data; }
code_block_3 = CodeBlock(x=maximumItem, y=code_block_2) { x/y; }
round = Math.Round(number=code_block_3)
code_block_4 = CodeBlock(data=round) { data; }
pointsAtEqualSegmentLength = Curve.PointsAtEqualSegmentLength(divisions=code_block_4)  # unwired: curve
splitByPoints = Curve.SplitByPoints(curve=code_block, points=pointsAtEqualSegmentLength)
startPoint = Curve.StartPoint(curve=splitByPoints)
combine = List.Combine(comb=addItemToEnd, list1=map, list2=startPoint)
flatten = List.Flatten(list=combine)
byPoints = NurbsSurface.ByPoints(points=flatten)
NurbsSurface = Output(byPoints)
flatten_2 = List.Flatten(list=flatten)
points = Output(flatten_2)
