# Dynamo custom node Point.GridTriangle.dyf (Dynamo 2.6.1.8786)
# category: Landform.Geometry.Point
# Create a triangular grid of points over an area from a set of boundary curves.
# packages: Landform 2016.10.13

curves = Input(curves: var[]..[])
code_block = CodeBlock { 4; }
dividePoints = Custom[Curve.DividePoints](curve=curves, divisions=code_block)  # package Landform; Get the (start) points along an equally divided curve.
BoundPoints = Output(dividePoints)
join = List.Join()  # unwired: list0, list1
startMidPoint = Custom[Curve.StartMidPoint](curve=curves)  # package Landform; Get the start point and midpoint along the Curve.
XRange = Custom[Point.XRange](points=startMidPoint)  # package Landform; Get all X components and the minimum and maximum X components from a list of Points.
spacing = Input(spacing: var[]..[])
YRange = Custom[Point.YRange](points=startMidPoint)  # package Landform; Get all Y components and the minimum and maximum Y components from a list of Points.
code_block_2 = CodeBlock(xmin=XRange.min, space=spacing, ymin=YRange.min, xmax=XRange.max, ymax=YRange.max) { xmin+space/3; ymin+space/3; xmax-xmin; ymax-ymin; }
byCoordinates = Point.ByCoordinates(x=code_block_2.out0, y=code_block_2.out1)
code_block_3 = CodeBlock(pt=byCoordinates, x=code_block_2.out2, y=code_block_2.out3, space=spacing) { pt.X; pt.Y; pt.X+x; pt.Y+y; pt.X+space/2; pt.Y+space*0.8666; }
code_block_4 = CodeBlock(xstart=code_block_3.out0, x=code_block_3.out2, space=spacing, ystart=code_block_3.out1, y=code_block_3.out3, xoff=code_block_3.out4, yoff=code_block_3.out5)
# ---------- code_block_4.designscript (9 lines) ----------
x_vals= xstart..x..space;
y_vals= ystart..y..space*0.8666*2;

Point.ByCoordinates(x_vals<1><2><3><4>,y_vals<3>);

x2_vals= xoff..x..space;
y2_vals= yoff..y..space*0.8666*2;

Point.ByCoordinates(x2_vals<1><2><3><4>,y2_vals<3>);
# ----------------------------------------
code_block_5 = CodeBlock(lst=code_block_4.out2) { Flatten(lst<1><2><3>); }
code_block_6 = CodeBlock(lst=code_block_5) { List.Flatten(lst,2); }
code_block_7 = CodeBlock(lst=code_block_4.out5) { Flatten(lst<1><2><3>); }
code_block_8 = CodeBlock(lst=code_block_7) { List.Flatten(lst,2); }
combine = List.Combine(comb=join, list1=code_block_6, list2=code_block_8)
GridPoints = Output(combine)
