# Dynamo custom node Point.GridTriangleContain.dyf (Dynamo 2.6.1.8786)
# category: Landform.Geometry.Point
# Create a triangular grid of points contained within a set of boundary curves.
# packages: Landform 2016.10.13

curves = Input(curves: var[]..[])
spacing = Input(spacing: var[]..[])
gridTriangle = Custom[Point.GridTriangle](curves=curves, spacing=spacing)  # package Landform; Create a triangular grid of points over an area from a set of boundary curves.
containmentTest = Polygon.ContainmentTest()  # unwired: polygon, point
byPoints = Polygon.ByPoints(points=gridTriangle.BoundPoints)
combine = List.Combine(comb=containmentTest, list1=byPoints, list2=gridTriangle.GridPoints)
filterByBoolMask = List.FilterByBoolMask(list=gridTriangle.GridPoints, mask=combine)
Points = Output(filterByBoolMask.in)
