# Dynamo custom node Point.Random.dyf (Dynamo 2.6.1.8786)
# category: Landform.Geometry.Point
# Creates a random set of points within a set of boundary cuves. Tolerance specifies the minimum distance between points. Actual number may not match input amount; see Point.RandomActual.

curves = Input(curves: var[]..[])
flatten = List.Flatten(list=curves)
byJoinedCurves = PolyCurve.ByJoinedCurves(curves=flatten)
patch = Curve.Patch(curve=byJoinedCurves)
amount = Input(amount: int)
randomList = Math.RandomList(amount=amount)
randomList_2 = Math.RandomList(amount=amount)
pointAtParameter = Surface.PointAtParameter(surface=patch, u=randomList, v=randomList_2)
tolerance = Input(tolerance: double)
pruneDuplicates = Point.PruneDuplicates(points=pointAtParameter, tolerance=tolerance)
perimeterCurves = Surface.PerimeterCurves(surface=patch)
startPoint = Curve.StartPoint(curve=perimeterCurves)
byPoints = Polygon.ByPoints(points=startPoint)
containmentTest = Polygon.ContainmentTest(polygon=byPoints, point=pruneDuplicates)
filterByBoolMask = List.FilterByBoolMask(list=pruneDuplicates, mask=containmentTest)
Points = Output(filterByBoolMask.in)
