# Dynamo custom node Point.RandomActual.dyf (Dynamo 2.6.1.8786)
# category: Landform.Geometry.Point
# Creates the specified amount of random points within a set boundary curves. Tolerance specifies the minimum distance between points.
# packages: Landform 2016.10.13

amount = Input(amount: int)
curves = Input(curves: var[]..[])
tolerance = Input(tolerance: double)
random = Custom[Point.Random](amount=amount, curves=curves, tolerance=tolerance)  # package Landform; Creates a random set of points within a set of boundary cuves. Tolerance specifies the minimum distance between points.
count = List.Count(list=random)
code_block = CodeBlock(amt=amount, ct=count) { amt/ct*amt*2; }
round = Math.Round(number=code_block)
random_2 = Custom[Point.Random](amount=round, curves=curves, tolerance=tolerance)
shuffle = List.Shuffle(list=random_2)
takeItems = List.TakeItems(list=shuffle, amount=amount)
Points = Output(takeItems)
