# Dynamo custom node Point.RandomAmount.dyf (Dynamo 0.9.0.3067)
# category: Landform.Geometry.Point
# Creates the specified amount of random points within a set boundary curves. Tolerance specifies the minimum distance between points.

amount = Input(amount : int)
curves = Input(curves : var[]..[])
tolerance = Input(tolerance : double)
random = Custom[Point.Random](amount=amount, curves=curves, tolerance=tolerance)  # Creates a random set of points within a set of boundary cuves. Tolerance specifies a minimum distance between points.
count = Count(random)
code_block = CodeBlock(amt=amount, ct=count) { amt/ct*amt*1.25; }
round = Math.Round(code_block)
random_2 = Custom[Point.Random](amount=round, curves=curves, tolerance=tolerance)
takeItems = List.TakeItems(list=random_2, amount=amount)
Points = Output(takeItems)
