# Dynamo custom node Point.ShiftCoordinates.dyf (Dynamo 2.6.1.8786)
# category: Landform.Geometry.Point
# Shifts the points by the X,Y, and Z values of the shift point. The default shift is positive (additive) but can be switched to negative (via boolean).

add = Input(add: bool = true)
code_block = CodeBlock { 1; }
code_block_2 = CodeBlock { -1; }
if_ = If(test=add, true=code_block, false=code_block_2)
shiftPoint = Input(shiftPoint: var[]..[])
X = Point.X(point=shiftPoint)
basePoint = Input(basePoint: var[]..[])
X_2 = Point.X(point=basePoint)
Y = Point.Y(point=shiftPoint)
Y_2 = Point.Y(point=basePoint)
Z = Point.Z(point=shiftPoint)
Z_2 = Point.Z(point=basePoint)
code_block_3 = CodeBlock(t=if_, sx=X, px=X_2, sy=Y, py=Y_2, sz=Z, pz=Z_2) { (t*sx)+px; (t*sy)+py; (t*sz)+pz; }
byCoordinates = Point.ByCoordinates(x=code_block_3.out0, y=code_block_3.out1, z=code_block_3.out2)
Point = Output(byCoordinates)
