# Dynamo custom node Point.XRange.dyf (Dynamo 2.6.1.8786)
# category: Landform.Geometry.Point
# Get all X components and the minimum and maximum X components from a list of Points.

points = Input(points: var[]..[])
X = Point.X(point=points)
double = Output(X)
minimumItem = List.MinimumItem(list=X)
min = Output(minimumItem)
maximumItem = List.MaximumItem(list=X)
max = Output(maximumItem)
