# Dynamo custom node Point.XYZ.dyf (Dynamo 2.6.1.8786)
# category: Landform.Geometry.Point
# Get the X, Y, and Z components of a Point

point = Input(point: var[]..[])
X = Point.X(point=point)
X_2 = Output(X)  # "X"
Y = Point.Y(point=point)
Y_2 = Output(Y)  # "Y"
Z = Point.Z(point=point)
Z_2 = Output(Z)  # "Z"
