# Dynamo custom node Point.XYZByCoordinates.dyf (Dynamo 2.6.1.8786)
# category: Landform.Geometry.Point
# Get the X,Y, and Z components and create a point from those coordinates.

pointX = Input(pointX: var[]..[])
X = Point.X(point=pointX)
pointY = Input(pointY: var[]..[])
Y = Point.Y(point=pointY)
pointZ = Input(pointZ: var[]..[])
Z = Point.Z(point=pointZ)
byCoordinates = Point.ByCoordinates(x=X, y=Y, z=Z)
Point = Output(byCoordinates)
