# Dynamo custom node Point.YRange.dyf (Dynamo 2.6.1.8786)
# category: Landform.Geometry.Point
# Get all Y components and the minimum and maximum Y components from a list of Points.

points = Input(points: var[]..[])
Y = Point.Y(point=points)
double = Output(Y)
minimumItem = List.MinimumItem(list=Y)
min = Output(minimumItem)
maximumItem = List.MaximumItem(list=Y)
max = Output(maximumItem)
