# Dynamo custom node Point.ZRange.dyf (Dynamo 2.6.1.8786)
# category: Landform.Geometry.Point
# Get all Z components and the minimum and maximum Z components from a list of Points.

points = Input(points: var[]..[])
Z = Point.Z(point=points)
double = Output(Z)
minimumItem = List.MinimumItem(list=Z)
min = Output(minimumItem)
maximumItem = List.MaximumItem(list=Z)
max = Output(maximumItem)
