# Dynamo custom node Points.SameXY.dyf (Dynamo 2.6.1.8786)
# category: Landform.Geometry.Point
# Find points that share the same XY (or overlap in plan). Used for creating Topography.

points = Input(points: var[]..[])
round = Input(round: int = 3)  # Rounds the points to a specified number of digits after the decimal. Rounding is used in the sorting process, but points will not be rounded
sortByXY = Custom[Points.SortByXY](points=points, round=round)  # Sort list of points based on its X and Y coordinate values. In order to sort correctly, points must be rounded (default value is 3 decimal points).

# group: pull y value, shift in both directions, then check if equals
Y = Point.Y(point=sortByXY.XthenY)
code_block = CodeBlock { -1; }
shiftIndices = List.ShiftIndices(list=Y, amount=code_block)
eq = Y == shiftIndices
code_block_2 = CodeBlock { 1; }
shiftIndices_2 = List.ShiftIndices(list=Y, amount=code_block_2)
eq_2 = Y == shiftIndices_2

# group: pull x value, shift in both directions, then check if equals
X = Point.X(point=sortByXY.XthenY)
code_block_3 = CodeBlock { -1; }
shiftIndices_3 = List.ShiftIndices(list=X, amount=code_block_3)
eq_3 = X == shiftIndices_3
code_block_4 = CodeBlock { 1; }
shiftIndices_4 = List.ShiftIndices(list=X, amount=code_block_4)
eq_4 = X == shiftIndices_4

# group: check both x and y are true, then filter
and_ = eq && eq_3
filterByBoolMask = List.FilterByBoolMask(list=sortByXY.XthenY, mask=and_)
and_2 = eq_2 && eq_4
filterByBoolMask_2 = List.FilterByBoolMask(list=sortByXY.XthenY, mask=and_2)

# group: join lists, then pull only unique indices (remove duplicates)
join = List.Join(list0=filterByBoolMask.in, list1=filterByBoolMask_2.in)
indexOf = List.IndexOf(list=sortByXY.XthenY, element=join)
uniqueItems = List.UniqueItems(list=indexOf)
sort = List.Sort(list=uniqueItems)

count = List.Count(list=sort)
count_2 = Output(count)  # "count"; The number of points that have the same XY
getItemAtIndex = List.GetItemAtIndex(list=sortByXY.XthenY, index=sort)
sameXYpoints = Output(getItemAtIndex)  # The points that have the same XY
sortedAllPoints = Output(sortByXY.XthenY)  # List of all input points, sorted by X, then by Y values
indicies = Output(sort)  # The indicies of the same XYs from the sorted list of all points
