# Dynamo custom node Points.SortByDistance.dyf (Dynamo 2.6.1.8786)
# category: Landform.Core.List
# Sort a list of points based on their distance from a specified point
# packages: Landform 2016.10.13

points = Input(points: var[]..[])
basePoint = Input(basePoint: var[]..[])
matchLength = Custom[List.MatchLength](listLength=points, list=basePoint)  # package Landform; Cycle a list to match the length of the first list.
byStartPointEndPoint = Line.ByStartPointEndPoint(startPoint=matchLength, endPoint=points)
length = Curve.Length(curve=byStartPointEndPoint)
sortByKey = Custom[List.SortByKey](list=points, keys=length)  # package Landform; Sort a list (or lists) according to the order specified by the key list.
sorted_list = Output(sortByKey.sorted_list)
