# Dynamo custom node Points.SortByXY.dyf (Dynamo 2.6.1.8786)
# category: Landform.Core.List
# Sort list of points based on its X and Y coordinate values. In order to sort correctly, points must be rounded (default value is 3 decimal points).

points = Input(points: var[]..[])
Y = Point.Y(point=points)
round = Input(round: int = 3)
round_2 = Math.Round(number=Y, digits=round)
sortByKey = List.SortByKey(list=points, keys=round_2)
X = Point.X(point=sortByKey.sorted_list)
round_3 = Math.Round(number=X, digits=round)
sortByKey_2 = List.SortByKey(list=sortByKey.sorted_list, keys=round_3)
XthenY = Output(sortByKey_2.sorted_list)
X_2 = Point.X(point=points)
round_4 = Math.Round(number=X_2, digits=round)
sortByKey_3 = List.SortByKey(list=points, keys=round_4)
Y_2 = Point.Y(point=sortByKey_3.sorted_list)
round_5 = Math.Round(number=Y_2, digits=round)
sortByKey_4 = List.SortByKey(list=sortByKey_3.sorted_list, keys=round_5)
YthenX = Output(sortByKey_4.sorted_list)
