# Dynamo custom node PointsFromCSV.dyf (Dynamo 2.6.1.8786)
# category: Landform.Geometry.Point
# Imports data points from a text file containing comma separated values.

filePath = Input(filePath: var[]..[])
importCSV = Data.ImportCSV(filePath=filePath)
code_block = CodeBlock(a=importCSV) { a[0]; a[1]; a[2]; }
byCoordinates = Point.ByCoordinates(x=code_block.out0, y=code_block.out1, z=code_block.out2)
Points = Output(byCoordinates)
