# Dynamo custom node PointsToCSV.dyf (Dynamo 2.6.1.8786)
# category: Landform.Core.File.CSV
# Write a list of points into a file using a comma-separated values format.

filePath = Input(filePath: var[]..[])
points = Input(points: var[]..[])
flatten = List.Flatten(list=points)
X = Point.X(point=flatten)
Y = Point.Y(point=flatten)
Z = Point.Z(point=flatten)
list_create = List.Create(item0=X, item1=Y, item2=Z)
round = Input(round: int = 3)
round_2 = Math.Round(number=list_create, digits=round)
transpose = List.Transpose(lists=round_2)
exportCSV = Data.ExportCSV(filePath=filePath, data=transpose)
str = Output(exportCSV)
