# Dynamo custom node SlabShape.AddAdjacentPoints.dyf (Dynamo 2.6.1.8786)
# category: Landform.Revit.Elements.Floor
# Add and match adjacent slab shape points (Floor or Roof) from Slab 1 to Slab 2. (requires Spring Nodes and Clockwork packages)
# packages: Landform 2016.10.13, Clockwork for Dynamo 2.x 2.3.0, spring nodes 203.2.0

Slab2 = Input(Slab2: var[]..[])
code_block = CodeBlock(data=Slab2) { data; }
points = Custom[SlabShape.Points](FloorOrRoof=code_block)  # package Landform; Get the XYZ points of any slab shape Roof or Floor.
ꟿ_collect_elementsketch = Custom[ꟿ Collect.ElementSketch](element=code_block)  # package spring nodes; Get the actual sketch lines of a sketch based element (floor, ceiling, modified wall, etc.) . You can optionally fetch the matching model curves, however this might prove comptationally heavy on larger data sets. Does not work with elements from linked files.
flatten = List.Flatten(list=ꟿ_collect_elementsketch.curves)
byJoinedCurves = PolyCurve.ByJoinedCurves(curves=flatten)
ZAxis = Vector.ZAxis()
Slab1 = Input(Slab1: var[]..[])
code_block_2 = CodeBlock(data=Slab1) { data; }
points_2 = Custom[SlabShape.Points](FloorOrRoof=code_block_2, lacing=CrossProduct)
flatten_2 = List.Flatten(list=points_2)
ZRange = Custom[Point.ZRange](points=flatten_2)  # package Landform; Get all Z components and the minimum and maximum Z components from a list of Points.
code_block_3 = CodeBlock(z=ZRange.max) { z+1; }
firstItem = List.FirstItem(list=flatten)
startPoint = Curve.StartPoint(curve=firstItem)
Z = Point.Z(point=startPoint)
code_block_4 = CodeBlock(z1=code_block_3, z2=Z) { z1-z2; }
extrude = Curve.Extrude(curve=byJoinedCurves, direction=ZAxis, distance=code_block_4)
intersectAll = Geometry.IntersectAll(geometry=extrude, others=flatten_2, lacing=CrossProduct)
flatten_3 = List.Flatten(list=intersectAll)
join = List.Join(list0=points, list1=flatten_3)
passthrough = Custom[Passthrough](passThrough=join, waitFor=join)  # package Clockwork for Dynamo 2.x; Forces a sequential order of execution. The node wired into the output of the Passthrough node will be executed *after* the node wired into the waitFor input (e.g. important for some Revit operations). The value of the passThrough input will be passed on to the node wired into the output port of the Passthrough node.
slabShapeByPoints = Custom[Floor.SlabShapeByPoints](points=passthrough, floor=code_block)  # package Clockwork for Dynamo 2.x; Transform a slab shape based on a list of Points
floor = Output(slabShapeByPoints.floor)
