# Dynamo custom node SlabShape.AdjacentPoints.dyf (Dynamo 0.9.2.4472)
# category: Landform.Revit.Elements.Floor
# Get the adjacent slab shape points between two adjacent Floors.

Floor2 = Input()
points = Custom[SlabShape.Points](FloorOrRoof=Floor2)  # Get the XYZ points of any slab shape Roof or Floor.
Floor1 = Input()
points_2 = Custom[SlabShape.Points](FloorOrRoof=Floor1)
XYZ = Custom[Point.XYZ](point=points_2)  # Get the X, Y, and Z components of a Point
code_block = CodeBlock { 3; }
round = Math.Round(number=XYZ.X, digits=code_block)
round_2 = Math.Round(number=XYZ.Y, digits=code_block)
byCoordinates = Point.ByCoordinates(x=round, y=round_2)
XYZ_2 = Custom[Point.XYZ](point=points)
code_block_2 = CodeBlock { 3; }
round_3 = Math.Round(number=XYZ_2.X, digits=code_block_2)
round_4 = Math.Round(number=XYZ_2.Y, digits=code_block_2)
byCoordinates_2 = Point.ByCoordinates(x=round_3, y=round_4)
equals = Custom[IndexOf.Equals](listA=byCoordinates, listB=byCoordinates_2)  # Returns the indices of items in list B that are equal to items in list A.
getItemAtIndex = List.GetItemAtIndex(list=points, index=equals)
Points2 = Output(getItemAtIndex)
sortByXY = Custom[Points.SortByXY](points=getItemAtIndex)  # Sort list of points based on its X and Y coordinate values. In order to sort correctly, points must be rounded (default value is 3 decimal points).
indexOf = IndexOf(getItemAtIndex)
map = List.Map(list=sortByXY.XthenY, f_x=indexOf)
Index = Output(map)
equals_2 = Custom[IndexOf.Equals](listA=byCoordinates_2, listB=byCoordinates)
getItemAtIndex_2 = List.GetItemAtIndex(list=points_2, index=equals_2)
sortByXY_2 = Custom[Points.SortByXY](points=getItemAtIndex_2)
Points1 = Output(sortByXY_2.XthenY)
IndexOriginal = Output(equals)
