# Dynamo custom node SlabShape.MatchPoints.dyf (Dynamo 0.9.2.4472)
# category: Landform.Revit.Elements.Floor
# Match the adjacent slab shape points from Floor 1 to Floor 2. (requires Clockwork package)

Floor2 = Input()
points = Custom[SlabShape.Points](FloorOrRoof=Floor2)  # Get the XYZ points of any slab shape Roof or Floor.
Floor1 = Input()
adjacentPoints = Custom[SlabShape.AdjacentPoints](Floor1=Floor1, Floor2=Floor2)  # Get the adjacent slab shape points between two adjacent Floors.
replaceItemAtIndex = Custom[List.ReplaceItemAtIndex](seq=adjacentPoints.Points2, index=adjacentPoints.Index, replacement=adjacentPoints.Points1)  # Replaces the item at a given index (or list of indices) of a list by another item
replaceItemAtIndex_2 = Custom[List.ReplaceItemAtIndex](seq=points, index=adjacentPoints.IndexOriginal, replacement=replaceItemAtIndex)
slabShapeByPoints = Custom[Floor.SlabShapeByPoints](points=replaceItemAtIndex_2, floor=Floor2)  # Transform a slab shape based on a list of XYZs. PLEASE NOTE: Will reset any previous edits on the slab shape.
floor = Output(slabShapeByPoints)
