# Dynamo custom node SlabShape.Points.dyf (Dynamo 2.6.1.8786)
# category: Landform.Revit.Elements.Floor
# Get the XYZ points of any slab shape Roof or Floor.

FloorOrRoof = Input(FloorOrRoof: var[]..[])
python_script = Python(IN[0]=FloorOrRoof)
# ---------- python_script.python (14 lines) ----------
import clr

clr.AddReference("RevitNodes")
import Revit
clr.ImportExtensions(Revit.GeometryConversion)

slabshape = UnwrapElement(IN[0])
points = []

vert = slabshape.SlabShapeEditor.SlabShapeVertices
for v in vert:
	points.append(v.Position.ToPoint(True))

OUT = points
# ----------------------------------------
Points = Output(python_script)
