# Dynamo custom node Surfaces.TopBasePolysurface.dyf (Dynamo 2.6.1.8786)
# category: Landform.Geometry.Surface
# Get the top and bottom polysurfaces from a set of surfaces.

surfaces = Input(surfaces: var[]..[])
count = List.Count(list=surfaces)
code_block = CodeBlock { 1; }
gt = count > code_block
getItemAtIndex = List.GetItemAtIndex()  # unwired: list, index
code_block_2 = CodeBlock { 1; }
flatten = List.Flatten(list=surfaces, amt=code_block_2)
code_block_3 = CodeBlock { 2; }
cycle = List.Cycle(list=surfaces, amount=code_block_3)
code_block_4 = CodeBlock(test=gt, iftrue=flatten, iffalse=cycle) { oldif(test,iftrue,iffalse); }
code_block_5 = CodeBlock(data=code_block_4) { data; }
code_block_6 = CodeBlock { 0.5; }
normalAtParameter = Surface.NormalAtParameter(surface=code_block_5, u=code_block_6, v=code_block_6)
Z = Vector.Z(vector=normalAtParameter)
code_block_7 = CodeBlock { 3; }
round = Math.Round(number=Z, digits=code_block_7)
code_block_8 = CodeBlock { 0; }
gt_2 = round > code_block_8
code_block_9 = CodeBlock { true; }
allIndicesOf = List.AllIndicesOf(item=code_block_9)  # unwired: list
map = List.Map(list=gt_2, f_x=allIndicesOf)
combine = List.Combine(comb=getItemAtIndex, list1=code_block_5, list2=map)
byJoinedSurfaces = PolySurface.ByJoinedSurfaces()  # unwired: surfaces
map_2 = List.Map(list=combine, f_x=byJoinedSurfaces)
firstItem = List.FirstItem(list=map_2)
code_block_10 = CodeBlock(test=gt, iftrue=map_2, iffalse=firstItem) { oldif(test,iftrue,iffalse); }
PolySurfaceTop = Output(code_block_10)
lt = round < code_block_8
map_3 = List.Map(list=lt, f_x=allIndicesOf)
combine_2 = List.Combine(comb=getItemAtIndex, list1=code_block_5, list2=map_3)
map_4 = List.Map(list=combine_2, f_x=byJoinedSurfaces)
firstItem_2 = List.FirstItem(list=map_4)
code_block_11 = CodeBlock(test=gt, iftrue=map_4, iffalse=firstItem_2) { oldif(test,iftrue,iffalse); }
PolySurfaceBase = Output(code_block_11)
code_block_12 = CodeBlock()
# ---------- code_block_12.designscript (15 lines) ----------
def oldif(test,iftrue:var[]..[],
iffalse:var[]..[])
{
return = [Imperative]
{
if (test)
{
return = iftrue;
}
else
{
return = iffalse;
}
}
};
# ----------------------------------------
