# Dynamo custom node Topography.ByLines.dyf (Dynamo 2.6.1.8786)
# category: Landform.Revit.Elements.Topography
# Create a toposurface from lines. Generates points at a specified interval along the lines.

lines = Input(lines: var[]..[])
geometry = Element.Geometry(element=lines)
flatten = List.Flatten(list=geometry)
startPoint = Curve.StartPoint(curve=flatten)
length = Curve.Length(curve=flatten)
interval = Input(interval: var[]..[])
code_block = CodeBlock(len=length, x=interval) { len/x; }
round = Math.Round(number=code_block)
pointsAtEqualSegmentLength = Curve.PointsAtEqualSegmentLength(curve=flatten, divisions=round)
endPoint = Curve.EndPoint(curve=flatten)
list_create = List.Create(item0=startPoint, item1=pointsAtEqualSegmentLength, item2=endPoint)
flatten_2 = List.Flatten(list=list_create)
pruneDuplicates = Point.PruneDuplicates(points=flatten_2)
byPoints = Topography.ByPoints(points=pruneDuplicates)
Topography = Output(byPoints)
